# Grasshopper definition lookpts.gh (Grasshopper 0.9.75)

file = ReadFile(File="C:\Users\Marco\Documents\usedaysim\design\points.pts", PerLineParse=True)
file_2 = ReadFile(File="C:\Users\Marco\Documents\usedaysim\design\result.ill", PerLineParse=True)
split = TextSplit(Text=file_2, Separators=" ")
split_2 = TextSplit(Text=file, Separators=" ")
panel = Panel(split_2)
split_3 = SplitList(List=split, Index=4)  # -> ListA, simplify(ListB)
flip = FlipMatrix(Data=split_3.ListB)
item = ListItem(List=split_2, Index=0, Wrap=True)
item_2 = ListItem(List=split_2, Index=2, Wrap=True)
item_3 = ListItem(List=split_2, Index=1, Wrap=True)
item_4 = ListItem(List=split_2, Index=3, Wrap=True)
item_5 = ListItem(List=split_2, Index=5, Wrap=True)
item_6 = ListItem(List=split_2, Index=4, Wrap=True)
ma = MassAddition(Input=flip)  # -> flatten(Result), PartialResults
vec = VectorXYZ(XComponent=item_4, YComponent=item_6, ZComponent=item_5)  # -> flatten(Vector), Length
cluster = Cluster(X=item, Y=item_3, Z=item_2)
bnd = Bounds(Numbers=ma.Result)
dedomain = DeconstructDomain(Domain=bnd)  # -> Start, End
vdis = VectorDisplay(Anchor=cluster, Vector=vec.Vector)
circle = CircleCNR(Center=cluster, Normal=vec.Vector, Radius=Slider(0.1, range=0..0.1))
gradient = Gradient(
    LowerLimit=dedomain.Start,
    UpperLimit=dedomain.End,
    Parameter=ma.Result,
    stops=[0: RGB(0, 128, 0), 0.5: RGB(255, 255, 0), 1: RGB(255, 0, 0)])
boundary = BoundarySurfaces(Edges=circle)
preview = CustomPreview(Geometry=boundary, Shader=gradient)

# ==== cluster Cluster
X = ClusterInput()
Y = ClusterInput()
Z = ClusterInput()
pt = ConstructPoint(XCoordinate=X, YCoordinate=Y, ZCoordinate=Z)  # -> flatten(Point)
pt_2 = ClusterOutput(pt)
